# Grasshopper definition Crease Pattern Mesh Generation.gh (Grasshopper 1.0.7)
# plug-ins: EleFront, Weaverbird, Kangaroo2 Components

crv = Curve(<curve referenced from the Rhino model>)
crv_2 = Curve(<curve referenced from the Rhino model>)
rhatt = GetRhinoAttributes(Geometry=crv)  # -> Name, Layer, Color
rhatt_2 = GetRhinoAttributes(Geometry=crv_2)  # -> Name, Layer, Color
refcol = ReferenceByColor(Color=rhatt.Color)
refcol_2 = ReferenceByColor(Color=rhatt_2.Color)
crv_3 = Curve([<curve referenced from the Rhino model> x116])
line = Line(crv_3)

lng = ListLength()
random = Random(Range="0 to 10", Number=lng, Seed=Slider(48, range=0..100), Integers=True)
wheel = ColourWheel(
    Slider(10, range=0..10),
    ColourGrips_Style=10,
    ColourGrips_Grip=[5.527147297, 2.518001343, 0.9472050163, 4.08879767],
    ColourGrips_Lum=[0.2, 0.538782161],
    ColourGrips_Range=[0.6873188924, 0.6873188924, 0.6873188924, 0.6873188924],
    ColourGrips_Sat=[0.07560119737, 0.7843113542])
col = Colour(wheel)
legend = Legend(Colour=col, Tags=col, LegendType=101)
item = ListItem(List=col, Index=random, Wrap=True)

reset = Button()
folding = Slider(0, range=0..0.99)

# ---- group: Mountain fold lines
crv_4 = Curve(refcol)

# ----
angle = Panel("pi")
angle_2 = Panel("-pi")

# ---- group: mesh of flat folding pattern
# To start, Press the 'Reset' button below  then slowly change the 'Folding' slider.
# You can replace the mesh with a different
# pattern, and choose edges from it to assign
# to mountain or valley folds.
mesh = Mesh(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)

# ---- group: Valley fold lines
crv_5 = Curve(refcol_2)

# ----
crv_6 = Curve(reparameterize(line))
lng_2 = ListLength(List=crv_6)
mcx = MultipleCurves(Curves=crv_6)  # -> Points, IndexA, IndexB, ParamA, ParamB
series = Series(Start=0, Step=1, Count=lng_2)
int = Integer(series)
mindex = MemberIndex(Set=[mcx.IndexA, mcx.IndexB], Member=int)  # -> Index, Count
pshift = ShiftPaths(Data=mindex.Index, Offset=-1)
number_slider = Slider(0.0001, range=1e-05..0.1)
item_2 = ListItem(List=[mcx.ParamA, mcx.ParamB], Index=pshift, Wrap=True)
unflatten = UnflattenTree(Tree=item_2, Guide=mindex.Index)
cset = CreateSet(List=unflatten)  # -> Set, Map
larger = LargerThan(FirstNumber=cset.Set, SecondNumber=expr("1-x", number_slider))  # -> LargerThan, OrEqualTo
smaller = SmallerThan(FirstNumber=cset.Set, SecondNumber=number_slider)  # -> SmallerThan, OrEqualTo
or = GateOr(A=smaller.SmallerThan, B=larger.LargerThan)
cull = CullPattern(List=cset.Set, CullPattern=invert(or))
vb = VBScript(x=cull)  # -> out, A
# ---------- vb: VB ----------
    If x Is Nothing Then
      a = nothing
    Else
      a = x
    End If
# ---------- end vb ----------
shatter = Shatter(Curve=graft(crv_6), Parameters=vb.A)  # -> simplify(Segments)
end = EndPoints(Curve=shatter)  # -> Start, End
pt = Point([end.Start, end.End])
flatten = FlattenTree(Tree=pt, Path="{0}")
cullpt = CullDuplicates(Points=flatten, Tolerance=Slider(0.1, range=0..100), CullMode=1)  # -> Points, Indices, Valence
flatten_2 = FlattenTree(Tree=cullpt.Points, Path="{0}")

multiplication = Multiplication(A=angle, B=folding)
hingepoints = HingePoints(Mesh=mesh)  # -> _1, _2, _3, _4
multiplication_2 = Multiplication(A=angle_2, B=folding)
ln = Line(StartPoint=hingepoints._1, EndPoint=hingepoints._2)
show = Show(G=mesh)
hinge = Hinge(
    FoldStart=hingepoints._1,
    FoldEnd=hingepoints._2,
    Tip1=hingepoints._3,
    Tip2=hingepoints._4,
    RestAngle=multiplication,
    Strength=0.1)
hinge_2 = Hinge(
    FoldStart=hingepoints._1,
    FoldEnd=hingepoints._2,
    Tip1=hingepoints._3,
    Tip2=hingepoints._4,
    RestAngle=multiplication_2,
    Strength=0.1)
eval = EvaluateCurve(Curve=reparameterize(crv_5), Parameter=0.5)  # -> Point, Tangent, Angle
eval_2 = EvaluateCurve(Curve=reparameterize(crv_4), Parameter=0.5)  # -> Point, Tangent, Angle
eval_3 = EvaluateCurve(Curve=ln, Parameter=0.5)  # -> graft(Point), Tangent, Angle
dist = Distance(PointA=eval.Point, PointB=eval_3.Point)
dist_2 = Distance(PointA=eval_2.Point, PointB=eval_3.Point)
sort = SortList(Keys=dist)  # -> Keys, ValuesA
sort_2 = SortList(Keys=dist_2)  # -> Keys, ValuesA
item_3 = ListItem(List=sort.Keys, Index=0, Wrap=True)
item_4 = ListItem(List=sort_2.Keys, Index=0, Wrap=True)
smaller_2 = SmallerThan(FirstNumber=item_3, SecondNumber=0.01)  # -> flatten(SmallerThan), OrEqualTo
smaller_3 = SmallerThan(FirstNumber=item_4, SecondNumber=0.01)  # -> flatten(SmallerThan), OrEqualTo
cull_2 = CullPattern(List=hinge, CullPattern=smaller_3.SmallerThan)
cull_3 = CullPattern(List=hinge_2, CullPattern=smaller_2.SmallerThan)

# ---- group: maintain edge lengths
medges = MeshEdges(Mesh=mesh)  # -> NakedEdges, InteriorEdges, NonManifoldEdges
length_line = LengthLine(Line=[medges.NakedEdges, medges.InteriorEdges], Strength=1)

# ---- group: a weak plastic anchor on all points prevents drift
demesh = DeconstructMesh(Mesh=mesh)  # -> Vertices, Faces, Colours, Normals
plasticanchor = PlasticAnchor(Point=demesh.Vertices, Limit=0.01, Strength=0.001)

# ----
lng_3 = ListLength(List=line)
dup = DuplicateData(Data="0", Number=lng_3, Order=True)
cset_2 = CreateSet(List=item)  # -> Set, Map
panel = Panel(item)
branch = TreeBranch(Tree=flatten_2, Path=graft(dup), MaintainPaths=False)
mindex_2 = MemberIndex(Set=item, Member=cset_2.Set)  # -> Index, Count
graft = GraftTree(Tree=line, IncludeEmptyLists=True, IncludeNullItems=True)
item_5 = ListItem(Index=mindex_2.Index, Wrap=True)
unique_colours = Panel(cset_2.Set)
preview = CustomPreview(Geometry=item_5, Shader=graft(cset_2.Set))
indices_of_same_colour_group = Panel(mindex_2.Index)

# ---- group: Colour Group Selection
branch_per_colour = Slider(0, range=0..10)
tstat = TreeStatistics(Tree=item_5)  # -> Paths, Length, Count
item_6 = ListItem(List=tstat.Paths, Index=branch_per_colour, Wrap=True)
branch_2 = TreeBranch(Tree=item_5, Path=item_6, MaintainPaths=True)

# ----
solver = Solver(
    GoalObjects=[length_line, cull_3, cull_2, show, plasticanchor],
    Reset=reset,
    Threshold=1e-15,
    Tolerance=0.01,
    On=Toggle(False))  # -> I, V, O

crv_7 = Curve(graft)
pt_2 = Point(branch)
tolerance = Panel("0.001")
crv_cp = CurveClosestPoint(Point=pt_2, Curve=crv_7)  # -> Point, Parameter, Distance
isoncurve = CSharpScript(x=crv_7, y=pt_2)  # -> out, A; inputs x: Curve, y: Point3d
# ---------- isoncurve: C# ----------
    //We only use this method if there is a curve
    if(x != null)
    {
      //T is the paramenter on the curve
      double t;

      //A is assigned with true if closest point to y is within model tolerance,
      //otherwise it will be assigned false, and t will not be calculated
      A = x.ClosestPoint(y, out t, RhinoDoc.ActiveDoc.ModelAbsoluteTolerance);
    }
# ---------- end isoncurve ----------
panel_2 = Panel(isoncurve.A)
smaller_4 = SmallerThan(FirstNumber=crv_cp.Distance, SecondNumber=tolerance)  # -> SmallerThan, OrEqualTo
panel_3 = Panel(smaller_4.SmallerThan)

cull_4 = CullPattern(List=branch, CullPattern=panel_2)
crv_cp_2 = CurveClosestPoint(Point=cull_4, Curve=graft)  # -> Point, Parameter, Distance
shatter_2 = Shatter(Curve=graft, Parameters=crv_cp_2.Parameter)
line_2 = Line(shatter_2)
flatten_3 = FlattenTree(Tree=line_2, Path="{0}")
wbweave = WeaverbirdsMeshFromLinesWeaveBack(Lines=flatten_3, MaximumValence=Slider(4, range=0..10))
demesh_2 = DeconstructMesh(Mesh=wbweave)  # -> Vertices, Faces, Colours, Normals
item_7 = ListItem(List=flatten_3, Index=Slider(182, range=0..300), Wrap=True)
line_3 = Line(item_7)
