# Grasshopper definition Miura Minimal Deformation Unit Cell.gh (Grasshopper 1.0.7)
# plug-ins: Kangaroo2 Components

reset = Button()
original_geometry = OriginalGeometry()  # -> pt_4, curvepoint_2, pt_7, R_2, P, R
a_toggle = BooleanToggle(False)
b_toggle = BooleanToggle(False)
c_toggle = BooleanToggle(False)
d_toggle = BooleanToggle(False)
e_toggle = BooleanToggle(False)
f_toggle = BooleanToggle(False)
g_toggle = BooleanToggle(False)
h_toggle = BooleanToggle(False)
i_toggle = BooleanToggle(False)
multiplication = Multiplication(A=a_toggle, B=Slider(10000, range=0..10000))
multiplication_2 = Multiplication(A=b_toggle, B=Slider(10000, range=0..10000))
multiplication_3 = Multiplication(A=c_toggle, B=Slider(10000, range=0..10000))
multiplication_4 = Multiplication(A=d_toggle, B=Slider(10000, range=0..10000))
multiplication_5 = Multiplication(A=e_toggle, B=Slider(10000, range=0..10000))
multiplication_6 = Multiplication(A=f_toggle, B=Slider(10000, range=0..10000))
multiplication_7 = Multiplication(A=g_toggle, B=Slider(10000, range=0..10000))
multiplication_8 = Multiplication(A=h_toggle, B=Slider(10000, range=0..10000))
multiplication_9 = Multiplication(A=i_toggle, B=Slider(10000, range=0..10000))
number_slider = Slider(0.1, range=-3.141..3.141)
adg = XZPlane(Origin=Point(0, 0, 0))
Y = UnitY(Factor=1)
neg = Negative(Value=Y)
xy = XYPlane(Origin=Point(0, 0, 0))
beh = Move(Geometry=adg, Motion=Y)  # -> Geometry, Transform
cfi = Move(Geometry=adg, Motion=neg)  # -> Geometry, Transform
c_constraint = Point(Point(0.603474203, -1.012585914, 0))
d_constraint = Point(Point(0.9943544768, -0.01406448716, 0.04741312808))
g_constraint = Point(Point(2.003536275, 0.0001493409816, 0))
a_constraint = Point(Point(-0.007720407037, -0.003404116053, 0))
e_constraint = Point(Point(1.594888716, 0.9951173108, 0))
b_constraint = Point(Point(0.6432045441, 1.009852954, -0.04519361896))
f_constraint = Point(Point(1.60199563, -1.005479, 0))
h_constraint = Point(Point(2.5969636, 1.002224225, 0))
i_constraint = Point(Point(2.580629681, -1.005479, 0))
floor = Floor(Strength=1)  # disabled
on_cfi = OnPlane(Plane=cfi.Geometry, Strength=1)  # disabled
number_slider_2 = Slider(0, range=0..1)
grab = Grab(On=True, Strength=1, Range=3)  # -> Grab, Anchors
pi = Pi(Factor=1)
pi_2 = Pi(Factor=1)

# ---- group: Strong Hinges
number_slider_3 = Slider(0.001, range=0..1)

# ---- group: Core Geometry
A = Point(original_geometry.pt_4)
B = Point(original_geometry.curvepoint_2)
D = Point(original_geometry.P)
G = Point(original_geometry.R)
E = Point(original_geometry.pt_7)
H = Point(original_geometry.R_2)
srf4pt = _4PointSurface(CornerA=A, CornerB=E, CornerC=D)
srf4pt_2 = _4PointSurface(CornerA=D, CornerB=G, CornerC=H)
srf4pt_3 = _4PointSurface(CornerA=E, CornerB=D, CornerC=H)
srf4pt_4 = _4PointSurface(CornerA=A, CornerB=B, CornerC=E)

# ----
extensions = Extensions(G_2=E, A=B, G=B, G_3=H)  # -> G_4, pt_4, pt_3
cluster = Cluster(
    A=original_geometry.pt_4,
    B=original_geometry.curvepoint_2,
    C=extensions.pt_4,
    D=original_geometry.P,
    E=original_geometry.pt_7,
    F=extensions.G_4,
    G=original_geometry.R,
    H=original_geometry.R_2,
    I=extensions.pt_3)  # -> A_3, B_3, C_3, D_3, E_3, F_3, G_3, H_3, I_3
ln = Line(StartPoint=cluster.B_3, EndPoint=cluster.I_3)
len = Length(Curve=ln)
multiplication_10 = Multiplication(A=len, B=Slider(0.334, range=0..1))
ln_2 = Line(StartPoint=b_constraint, EndPoint=cluster.I_3)  # disabled
length_line = LengthLine(Line=ln, Length=multiplication_10, Strength=Slider(1, range=0..1))

# ---- group: Core Geometry (continued)
C = Point(extensions.pt_4)
F = Point(extensions.G_4)
I = Point(extensions.pt_3)
srf4pt_5 = _4PointSurface(CornerA=C, CornerB=D, CornerC=F)
srf4pt_6 = _4PointSurface(CornerA=A, CornerB=D, CornerC=C)
srf4pt_7 = _4PointSurface(CornerA=D, CornerB=F, CornerC=G)
srf4pt_8 = _4PointSurface(CornerA=F, CornerB=G, CornerC=I)
geo = Geometry([srf4pt_4, srf4pt, srf4pt_3, srf4pt_2, srf4pt_6, srf4pt_5, srf4pt_7, srf4pt_8])
join = BrepJoin(Breps=geo)  # -> Breps, Closed

# ---- group: Strong Hinges (continued)
hinge = Hinge(FoldStart=D, FoldEnd=C, Tip1=A, Tip2=F, Strength=number_slider_3)
hinge_2 = Hinge(FoldStart=G, FoldEnd=F, Tip1=D, Tip2=I, Strength=number_slider_3)
hinge_3 = Hinge(FoldStart=A, FoldEnd=E, Tip1=B, Tip2=D, Strength=number_slider_3)
hinge_4 = Hinge(FoldStart=D, FoldEnd=H, Tip1=E, Tip2=G, Strength=number_slider_3)
entwine = Entwine(Branch00=hinge_3, Branch01=hinge_4, Branch02=hinge, Branch03=hinge_2, FlattenInputs=True)

# ---- group: Weak Hinges
number_slider_4 = Slider(0.001, range=0..1)
hinge_5 = Hinge(FoldStart=D, FoldEnd=F, Tip1=C, Tip2=G, RestAngle=number_slider, Strength=number_slider_4)
hinge_6 = Hinge(FoldStart=E, FoldEnd=D, Tip1=A, Tip2=H, RestAngle=number_slider, Strength=number_slider_4)
hinge_7 = Hinge(FoldStart=A, FoldEnd=D, Tip1=E, Tip2=C, RestAngle=number_slider, Strength=number_slider_4)
hinge_8 = Hinge(FoldStart=A, FoldEnd=F, Tip1=D, Tip2=C, RestAngle=number_slider, Strength=number_slider_4)
entwine_2 = Entwine(Branch00=hinge_6, Branch01=hinge_7, Branch02=hinge_8, Branch03=hinge_5, FlattenInputs=True)

# ----
a_fix = Anchor(Point=cluster.A_3, Target=a_constraint, Strength=multiplication)
a_fix_2 = Anchor(Point=cluster.B_3, Strength=multiplication_2)
a_fix_3 = Anchor(Point=cluster.C_3, Target=c_constraint, Strength=multiplication_3)
a_fix_4 = Anchor(Point=cluster.D_3, Target=d_constraint, Strength=multiplication_4)
a_fix_5 = Anchor(Point=cluster.E_3, Target=e_constraint, Strength=multiplication_5)
a_fix_6 = Anchor(Point=cluster.F_3, Target=f_constraint, Strength=multiplication_6)
a_fix_7 = Anchor(Point=cluster.G_3, Target=g_constraint, Strength=multiplication_7)
a_fix_8 = Anchor(Point=cluster.H_3, Target=h_constraint, Strength=multiplication_8)
a_fix_9 = Anchor(Point=cluster.I_3, Target=i_constraint, Strength=multiplication_9)
on_beh = OnPlane(Points=[cluster.B_3, cluster.H_3], Plane=beh.Geometry, Strength=1)  # disabled
on_adg = OnPlane(Points=[cluster.A_3, cluster.G_3, cluster.D_3], Plane=adg, Strength=1)  # disabled
on_xy = OnPlane(Points=[cluster.B_3, cluster.I_3, cluster.C_3, cluster.H_3], Plane=xy, Strength=Slider(10000, range=0..10000))
mesh = MeshBrep(
    Brep=[srf4pt_4, srf4pt, srf4pt_3, srf4pt_2, srf4pt_6, srf4pt_5, srf4pt_7, srf4pt_8],
    Settings={GridMaxCount=0, GridMinCount=16, JaggedSeams=False, MaxEdgeLength=0, MinEdgeLength=0.0001, MinTolerance=0, Refine=True, RefineAngle=0, RelativeTolerance=0.65, SimplePlanes=True, Tolerance=0})
pt = Point([A, B, C, D, E, F, G, H, I])
constraints = Entwine(
    Branch00=[a_fix, a_fix_2, a_fix_3, a_fix_4, a_fix_5, a_fix_6, a_fix_7, a_fix_8, a_fix_9],
    Branch01=[on_xy, on_beh, on_adg, on_cfi],
    Branch02=floor,
    FlattenInputs=True)

# ---- group: Tags
number_slider_5 = Slider(0.146, range=0..1)
tag = TextTag3D(Location=A, Text="A", Size=number_slider_5, Justification=7)
tag_2 = TextTag3D(Location=B, Text="B", Size=number_slider_5, Justification=7)
tag_3 = TextTag3D(Location=C, Text="C", Size=number_slider_5, Justification=7)
tag_4 = TextTag3D(Location=D, Text="D", Size=number_slider_5, Justification=7)
tag_5 = TextTag3D(Location=E, Text="E", Size=number_slider_5, Justification=7)
tag_6 = TextTag3D(Location=F, Text="F", Size=number_slider_5, Justification=7)
tag_7 = TextTag3D(Location=G, Text="G", Size=number_slider_5, Justification=7)
tag_8 = TextTag3D(Location=H, Text="H", Size=number_slider_5, Justification=7)
tag_9 = TextTag3D(Location=I, Text="I", Size=number_slider_5, Justification=7)

# ----
forces = Entwine(Branch00=length_line, FlattenInputs=True)

# ---- group: Fold Through Prevention
nofoldthrough = NoFoldThrough(FoldStart=A, FoldEnd=E, Tip1=B, Tip2=D, Strength=number_slider_2)
nofoldthrough_2 = NoFoldThrough(FoldStart=D, FoldEnd=E, Tip1=A, Tip2=H, Strength=number_slider_2)
nofoldthrough_3 = NoFoldThrough(FoldStart=D, FoldEnd=H, Tip1=E, Tip2=G, Strength=number_slider_2)
nofoldthrough_4 = NoFoldThrough(FoldStart=A, FoldEnd=D, Tip1=E, Tip2=C, Strength=number_slider_2)
nofoldthrough_5 = NoFoldThrough(FoldStart=D, FoldEnd=G, Tip1=H, Tip2=F, Strength=number_slider_2)
nofoldthrough_6 = NoFoldThrough(FoldStart=C, FoldEnd=D, Tip1=A, Tip2=F, Strength=number_slider_2)
nofoldthrough_7 = NoFoldThrough(FoldStart=F, FoldEnd=G, Tip1=D, Tip2=I, Strength=number_slider_2)
nofoldthrough_8 = NoFoldThrough(FoldStart=D, FoldEnd=F, Tip1=C, Tip2=G, Strength=number_slider_2)
entwine_3 = Entwine(
    Branch00=nofoldthrough,
    Branch01=nofoldthrough_2,
    Branch02=nofoldthrough_3,
    Branch03=nofoldthrough_4,
    Branch04=nofoldthrough_5,
    Branch05=nofoldthrough_6,
    Branch06=nofoldthrough_8,
    Branch07=nofoldthrough_7,
    FlattenInputs=True)

# ----
plasticanchor = PlasticAnchor(Point=pt, Limit=1, Strength=pt, Reset=False)  # disabled

# ---- group: Flat Fold Restriction
edgelengths = EdgeLengths(Mesh=mesh, LengthFactor=1, Strength=1)
planarize = Planarize(M=srf4pt_4, Strength=1)  # disabled
entwine_4 = Entwine(Branch00=edgelengths, Branch01=planarize, FlattenInputs=True)

# ---- group: Display Controls
show = Show(G=mesh)

# ----
entwine_5 = Entwine(
    Branch00=grab.Grab,
    Branch01=show,
    Branch02=entwine_4,
    Branch03=entwine,
    Branch04=entwine_2,
    Branch05=entwine_3,
    Branch06=plasticanchor,
    Branch07=constraints,
    Branch08=forces,
    FlattenInputs=True)
solver = Solver(GoalObjects=entwine_5, Reset=reset, Threshold=1e-15, Tolerance=0.01, On=Toggle(False))  # -> I, V, O
bang = ExplodeTree(Data=solver.O)  # -> Branch0, Branch1, Branch2, Branch3, Branch4, Branch5, Branch6, Branch7
pt_2 = Point(solver.V)
rec = DataRecorder(pt_2, DataLimit=-10, RecordData=False)
vertex_data = Panel(rec)
demesh = DeconstructMesh(Mesh=bang.Branch0)  # -> Vertices, Faces, Colours, Normals
devec = DeconstructVector(Vector=solver.V)  # -> XComponent, YComponent, ZComponent
bang_2 = ExplodeTree(Data=demesh.Normals)  # -> Branch0, Branch1, Branch2, Branch3, Branch4, Branch5, Branch6, Branch7
sort = SortList(Keys=devec.ZComponent)  # -> Keys, ValuesA
t1 = Point(bang_2.Branch0)
t2 = Point(bang_2.Branch1)
t3 = Point(bang_2.Branch2)
t4 = Point(bang_2.Branch3)
b1 = Point(bang_2.Branch4)
b2 = Point(bang_2.Branch5)
b3 = Point(bang_2.Branch6)
b4 = Point(bang_2.Branch7)
item = ListItem(List=sort.Keys, Index=0, Wrap=True)
item_2 = ListItem(List=sort.Keys, Index=Slider(7, range=0..10), Wrap=True)
angle = Angle(VectorA=t3, VectorB=t4)  # -> Angle, Reflex
angle_2 = Angle(VectorA=t1, VectorB=t2)  # -> Angle, Reflex
angle_3 = Angle(VectorA=b1, VectorB=b2)  # -> Angle, Reflex
angle_4 = Angle(VectorA=b3, VectorB=b4)  # -> Angle, Reflex
subtraction = Subtraction(A=pi, B=angle_4.Angle)
gradient = Gradient(
    LowerLimit=Slider(0, range=0..100),
    UpperLimit=pi_2,
    Parameter=[subtraction, angle_2.Angle, angle.Angle, angle_3.Angle],
    stops=[0: RGB(0, 128, 0), 0.5: RGB(255, 255, 0), 1: RGB(255, 0, 0)])
item_3 = CherryPicker(angle_2.Angle, ListIndex=0)
tracker = ValueTracker(
    item_3,
    TrackerAutoDomain=False,
    TrackerColour=RGB(255, 155, 0),
    TrackerPeriod=10,
    TrackerUpdate=25,
    TrackerDomain=[0, 3.141592654])
item_4 = CherryPicker(angle.Angle, ListIndex=0)
tracker_2 = ValueTracker(
    item_4,
    TrackerAutoDomain=False,
    TrackerColour=RGB(255, 155, 0),
    TrackerPeriod=10,
    TrackerUpdate=25,
    TrackerDomain=[0, 3.141592654])
item_5 = CherryPicker(angle_3.Angle, ListIndex=0)
tracker_3 = ValueTracker(
    item_5,
    TrackerAutoDomain=False,
    TrackerColour=RGB(255, 155, 0),
    TrackerPeriod=10,
    TrackerUpdate=25,
    TrackerDomain=[0, 3.141592654])
item_6 = CherryPicker(subtraction, ListIndex=0)
tracker_4 = ValueTracker(
    item_6,
    TrackerAutoDomain=False,
    TrackerColour=RGB(255, 155, 0),
    TrackerPeriod=10,
    TrackerUpdate=25,
    TrackerDomain=[0, 3.141592654])
rec_2 = DataRecorder([tracker, tracker_2, tracker_3, tracker_4], DataLimit=-10, RecordData=False)
hinge_data = Panel(rec_2)
mcol = MeshColours(Mesh=bang.Branch0, Colours=gradient)
bang_3 = ExplodeTree(Data=gradient)  # -> Branch0, Branch1, Branch2, Branch3
bang_4 = ExplodeTree(Data=demesh.Faces)  # -> Branch0, Branch1, Branch2, Branch3, Branch4, Branch5, Branch6, Branch7
bang_5 = ExplodeTree(Data=demesh.Vertices)  # -> Branch0, Branch1, Branch2, Branch3, Branch4, Branch5, Branch6, Branch7
conmesh = ConstructMesh(Vertices=bang_5.Branch0, Faces=bang_4.Branch0, Colours=bang_3.Branch0)
conmesh_2 = ConstructMesh(Vertices=bang_5.Branch1, Faces=bang_4.Branch1, Colours=bang_3.Branch0)
conmesh_3 = ConstructMesh(Vertices=bang_5.Branch2, Faces=bang_4.Branch2, Colours=bang_3.Branch1)
conmesh_4 = ConstructMesh(Vertices=bang_5.Branch3, Faces=bang_4.Branch3, Colours=bang_3.Branch1)
conmesh_5 = ConstructMesh(Vertices=bang_5.Branch4, Faces=bang_4.Branch4, Colours=bang_3.Branch2)
conmesh_6 = ConstructMesh(Vertices=bang_5.Branch5, Faces=bang_4.Branch5, Colours=bang_3.Branch2)
conmesh_7 = ConstructMesh(Vertices=bang_5.Branch6, Faces=bang_4.Branch6, Colours=bang_3.Branch3)
conmesh_8 = ConstructMesh(Vertices=bang_5.Branch7, Faces=bang_4.Branch7, Colours=bang_3.Branch3)

# ==== cluster OriginalGeometry
panel = Panel("Point A")
panel_2 = Panel("Point B")
panel_3 = Panel("Point C")
number_slider = Slider(1, range=0..1)
number_slider_2 = Slider(0.598, range=0..1)
number_slider_3 = Slider(1, range=0..1)
vec = VectorXYZ(XComponent=Slider(0, range=0..1), YComponent=Slider(0, range=0..1), ZComponent=Slider(0, range=0..1))  # -> Vector, Length
vec_2 = VectorXYZ(XComponent=number_slider_2, YComponent=number_slider, ZComponent=Slider(0, range=0..1))  # -> Vector, Length
division = Division(A=number_slider, B=number_slider_2)
vec_3 = VectorXYZ(XComponent=number_slider_3, YComponent=Slider(0, range=0..1), ZComponent=Slider(0, range=0..1))  # -> Vector, Length
pt = Point(vec.Vector)
pt_2 = Point(vec_2.Vector)
atan = ArcTangent(Value=division)
pt_3 = Point(vec_3.Vector)
pt_4 = ClusterOutput(pt)
panel_4 = Panel("Point D")
addition = Addition(A=vec_2.Vector, B=vec_3.Vector)
pt_5 = Point(addition)
dom = ConstructDomain(DomainStart=atan, DomainEnd=Slider(0, range=0..100))
xy = XYPlane(Origin=Point(0, 0, 0))
Z = UnitZ(Factor=1)
srf4pt = _4PointSurface(CornerA=pt, CornerB=pt_2, CornerC=pt_5, CornerD=pt_3)
arc = Arc(Plane=xy, Radius=vec_2.Length, Angle=dom)  # -> Arc, Length
pl_3pt = Plane3Pt(PointA=pt, PointB=pt_3, PointC=Z)
# Slide this to collapse!
curvepoint = PointOnCurve(arc.Arc, parameter=0)
arc_2 = Arc(Plane=pl_3pt, Radius=number_slider_3, Angle=Domain(0, 3.141592654))  # -> Arc, Length
curvepoint_2 = ClusterOutput(curvepoint)
ln = Line(StartPoint=pt, EndPoint=pt_2)
ln_2 = Line(StartPoint=pt, EndPoint=curvepoint)
unit = UnitVector(Vector=pt_2)
angle = Angle(VectorA=ln, VectorB=ln_2)  # -> Angle, Reflex
dprod = DotProduct(VectorA=unit, VectorB=pt_3, Unitize=False)
neg = Negative(Value=angle.Angle)
multiplication = Multiplication(A=unit, B=dprod)
dist = Distance(PointA=pt_3, PointB=multiplication)
circle = CircleCNR(Center=multiplication, Normal=pt_2, Radius=dist)
rot3d = Rotate3D(Geometry=circle, Angle=neg, Center=Point(0, 0, 0), Axis=Vector(0, 0, 1))  # -> Geometry, Transform
ccx = CurveCurve(CurveA=rot3d.Geometry, CurveB=arc_2.Arc)  # -> Points, ParamsA, ParamsB
P = ClusterOutput(ccx.Points)
addition_2 = Addition(A=curvepoint, B=ccx.Points)
pdecon = Deconstruct(Point=ccx.Points)  # -> XComponent, YComponent, ZComponent
X = UnitX(Factor=1)
pt_6 = Point(addition_2)
multiplication_2 = Multiplication(A=pdecon.XComponent, B=X)
pt_7 = ClusterOutput(pt_6)
ln_3 = Line(StartPoint=curvepoint, EndPoint=pt_6)
ln_4 = Line(StartPoint=pt, EndPoint=ccx.Points)
ln_5 = Line(StartPoint=pt_6, EndPoint=ccx.Points)
pdecon_2 = Deconstruct(Point=curvepoint)  # -> XComponent, YComponent, ZComponent
pdecon_3 = Deconstruct(Point=pt_6)  # -> XComponent, YComponent, ZComponent
multiplication_3 = Multiplication(A=multiplication_2, B=Slider(2, range=0..10))
subtraction = Subtraction(A=pdecon_3.XComponent, B=pdecon_2.XComponent)
addition_3 = Addition(A=pt, B=multiplication_3)
R = ClusterOutput(addition_3)
multiplication_4 = Multiplication(A=subtraction, B=Slider(2, range=0..10))
X_2 = UnitX(Factor=1)
devec = DeconstructVector(Vector=addition_3)  # -> XComponent, YComponent, ZComponent
multiplication_5 = Multiplication(A=multiplication_4, B=X_2)
addition_4 = Addition(A=curvepoint, B=multiplication_5)
R_2 = ClusterOutput(addition_4)
srf4pt_2 = _4PointSurface(CornerA=pt, CornerB=curvepoint, CornerC=pt_6, CornerD=ccx.Points)
devec_2 = DeconstructVector(Vector=addition_4)  # -> XComponent, YComponent, ZComponent
pl_3pt_2 = Plane3Pt(PointA=addition_4, PointB=pt_6, PointC=curvepoint)
srf4pt_3 = _4PointSurface(CornerA=addition_4, CornerB=pt_6, CornerC=ccx.Points, CornerD=addition_3)
multiplication_6 = Multiplication(A=Slider(2, range=0..10), B=devec_2.YComponent)
mirror = Mirror(Geometry=[srf4pt_3, srf4pt_2], Plane=pl_3pt_2)  # -> Geometry, Transform
rectangle = Rectangle(Plane=PlaneXY(0, 0, 0), XSize=devec.XComponent, YSize=multiplication_6, Radius=0)  # -> Rectangle, Length
arrrec = RectangularArray(
    Geometry=[mirror.Geometry, srf4pt_3, srf4pt_2],
    Cell=rectangle.Rectangle,
    XCount=Slider(1, range=0..10),
    YCount=Slider(4, range=0..10))  # -> Geometry, Transform

# ==== cluster Extensions
xz = XZPlane(Origin=Point(0, 0, 0))
G = ClusterInput()
G_2 = ClusterInput()
G_3 = ClusterInput()
mirror = MirrorSurface(Geometry=G, Surface=xz, Frame=True)
mirror_2 = MirrorSurface(Geometry=G_2, Surface=xz, Frame=True)
mirror_3 = MirrorSurface(Geometry=G_3, Surface=xz, Frame=True)
G_4 = ClusterOutput(mirror_2)
pt = Point(mirror_3)
pt_2 = Point(mirror)
A = ClusterInput()
pt_3 = ClusterOutput(pt)
pt_4 = ClusterOutput(pt_2)
ln = Line(StartPoint=A, EndPoint=pt_2)
ln_2 = Line(StartPoint=pt_2, EndPoint=pt)
number_slider = Slider(1, range=0..10)
number_slider_2 = Slider(1, range=0..10)
recgrid = Rectangular(Plane=pt_2, SizeX=ln_2, SizeY=ln, ExtentX=1, ExtentY=1)  # -> flatten(Cells), Points

# ==== cluster Cluster
A = ClusterInput()
B = ClusterInput()
C = ClusterInput()
F = ClusterInput()
G = ClusterInput()
I = ClusterInput()
D = ClusterInput()
E = ClusterInput()
H = ClusterInput()
A_2 = Point(A)
B_2 = Point(B)
C_2 = Point(C)
F_2 = Point(F)
G_2 = Point(G)
I_2 = Point(I)
D_2 = Point(D)
E_2 = Point(E)
H_2 = Point(H)
A_3 = ClusterOutput(A_2)
B_3 = ClusterOutput(B_2)
C_3 = ClusterOutput(C_2)
F_3 = ClusterOutput(F_2)
G_3 = ClusterOutput(G_2)
I_3 = ClusterOutput(I_2)
D_3 = ClusterOutput(D_2)
E_3 = ClusterOutput(E_2)
H_3 = ClusterOutput(H_2)
