# Grasshopper definition Functional Controlled Miura Deformation.ghx (Grasshopper 1.0.7)
# plug-ins: Kangaroo2 Components

original_geometry = OriginalGeometry()  # -> pt_2, curvepoint_2, pt_7, R_2, P, R
number_slider = Slider(0, range=-3.141..3.141)
X = UnitX(Factor=1)
multiplication = Multiplication(A=Slider(0.502, range=0..1), B=X)
xy = XYPlane(Origin=Point(0, 0, 0))
number_slider_2 = Slider(0, range=0..1)
grab = Grab(On=True, Strength=1, Range=3)  # -> Grab, Anchors
reset = Button()
colour = ColourPicker(PickedColour=RGB(255, 245, 227))
material = CreateMaterial(Diffuse=colour, Specular=RGB(255, 255, 255), Emission=RGB(0, 0, 0), Transparency=0, Shine=0)

# ---- group: Strong Hinges
number_slider_3 = Slider(0.11, range=0..1)

# ---- group: Core Geometry
A = Point(original_geometry.pt_2)
B = Point(original_geometry.curvepoint_2)
D = Point(original_geometry.P)
G = Point(original_geometry.R)
E = Point(original_geometry.pt_7)
H = Point(original_geometry.R_2)
srf4pt = _4PointSurface(CornerA=A, CornerB=E, CornerC=D)
srf4pt_2 = _4PointSurface(CornerA=D, CornerB=G, CornerC=H)
srf4pt_3 = _4PointSurface(CornerA=E, CornerB=D, CornerC=H)
srf4pt_4 = _4PointSurface(CornerA=A, CornerB=B, CornerC=E)

# ----
extensions = Extensions(G=E, A=B, G_2=B, G_3=H)  # -> G_4, pt_4, pt_2

# ---- group: Core Geometry (continued)
C = Point(extensions.pt_4)
F = Point(extensions.G_4)
I = Point(extensions.pt_2)
srf4pt_5 = _4PointSurface(CornerA=C, CornerB=D, CornerC=F)
srf4pt_6 = _4PointSurface(CornerA=A, CornerB=D, CornerC=C)
srf4pt_7 = _4PointSurface(CornerA=D, CornerB=F, CornerC=G)
srf4pt_8 = _4PointSurface(CornerA=F, CornerB=G, CornerC=I)
geo = Geometry([srf4pt_4, srf4pt, srf4pt_3, srf4pt_2, srf4pt_6, srf4pt_5, srf4pt_7, srf4pt_8])
join = BrepJoin(Breps=geo)  # -> Breps, Closed

# ---- group: Strong Hinges (continued)
hinge = Hinge(FoldStart=D, FoldEnd=C, Tip1=A, Tip2=F, Strength=number_slider_3)
hinge_2 = Hinge(FoldStart=G, FoldEnd=F, Tip1=D, Tip2=I, Strength=number_slider_3)
hinge_3 = Hinge(FoldStart=A, FoldEnd=E, Tip1=B, Tip2=D, Strength=number_slider_3)
hinge_4 = Hinge(FoldStart=D, FoldEnd=H, Tip1=E, Tip2=G, Strength=number_slider_3)
entwine = Entwine(Branch00=hinge_3, Branch01=hinge_4, Branch02=hinge, Branch03=hinge_2, FlattenInputs=True)

# ---- group: Weak Hinges
number_slider_4 = Slider(0.095, range=0..1)
hinge_5 = Hinge(FoldStart=D, FoldEnd=F, Tip1=C, Tip2=G, RestAngle=number_slider, Strength=number_slider_4)
hinge_6 = Hinge(FoldStart=E, FoldEnd=D, Tip1=A, Tip2=H, RestAngle=number_slider, Strength=number_slider_4)
hinge_7 = Hinge(FoldStart=A, FoldEnd=D, Tip1=E, Tip2=C, RestAngle=number_slider, Strength=number_slider_4)
hinge_8 = Hinge(FoldStart=D, FoldEnd=G, Tip1=H, Tip2=F, RestAngle=number_slider, Strength=number_slider_4)
entwine_2 = Entwine(Branch00=hinge_6, Branch01=hinge_7, Branch02=hinge_8, Branch03=hinge_5, FlattenInputs=True)

# ----
mesh = MeshBrep(
    Brep=[srf4pt_4, srf4pt, srf4pt_3, srf4pt_2, srf4pt_6, srf4pt_5, srf4pt_7, srf4pt_8],
    Settings={GridMaxCount=0, GridMinCount=16, JaggedSeams=False, MaxEdgeLength=0, MinEdgeLength=0.0001, MinTolerance=0, Refine=True, RefineAngle=0, RelativeTolerance=0.65, SimplePlanes=True, Tolerance=0})
pt = Point([A, B, C, D, E, F, G, H, I])
load = Load(Point=B, ForceVector=multiplication, Weighting=1)
anchor = Anchor(Point=H, Strength=Toggle(True))
anchor_2 = Anchor(Point=B, Strength=Slider(0.771, range=0..1))

# ---- group: Tags
number_slider_5 = Slider(0.146, range=0..1)
tag = TextTag3D(Location=A, Text="A", Size=number_slider_5, Justification=7)
tag_2 = TextTag3D(Location=B, Text="B", Size=number_slider_5, Justification=7)
tag_3 = TextTag3D(Location=C, Text="C", Size=number_slider_5, Justification=7)
tag_4 = TextTag3D(Location=D, Text="D", Size=number_slider_5, Justification=7)
tag_5 = TextTag3D(Location=E, Text="E", Size=number_slider_5, Justification=7)
tag_6 = TextTag3D(Location=F, Text="F", Size=number_slider_5, Justification=7)
tag_7 = TextTag3D(Location=G, Text="G", Size=number_slider_5, Justification=7)
tag_8 = TextTag3D(Location=H, Text="H", Size=number_slider_5, Justification=7)
tag_9 = TextTag3D(Location=I, Text="I", Size=number_slider_5, Justification=7)

# ----
onplane = OnPlane(Points=[C, I], Plane=xy, Strength=1)

# ---- group: Fold Through Prevention
nofoldthrough = NoFoldThrough(FoldStart=A, FoldEnd=E, Tip1=B, Tip2=D, Strength=number_slider_2)
nofoldthrough_2 = NoFoldThrough(FoldStart=D, FoldEnd=E, Tip1=A, Tip2=H, Strength=number_slider_2)
nofoldthrough_3 = NoFoldThrough(FoldStart=D, FoldEnd=H, Tip1=E, Tip2=G, Strength=number_slider_2)
nofoldthrough_4 = NoFoldThrough(FoldStart=A, FoldEnd=D, Tip1=E, Tip2=C, Strength=number_slider_2)
nofoldthrough_5 = NoFoldThrough(FoldStart=D, FoldEnd=G, Tip1=H, Tip2=F, Strength=number_slider_2)
nofoldthrough_6 = NoFoldThrough(FoldStart=C, FoldEnd=D, Tip1=A, Tip2=F, Strength=number_slider_2)
nofoldthrough_7 = NoFoldThrough(FoldStart=F, FoldEnd=G, Tip1=D, Tip2=I, Strength=number_slider_2)
nofoldthrough_8 = NoFoldThrough(FoldStart=D, FoldEnd=F, Tip1=C, Tip2=G, Strength=number_slider_2)
entwine_3 = Entwine(
    Branch00=nofoldthrough,
    Branch01=nofoldthrough_2,
    Branch02=nofoldthrough_3,
    Branch03=nofoldthrough_4,
    Branch04=nofoldthrough_5,
    Branch05=nofoldthrough_6,
    Branch06=nofoldthrough_8,
    Branch07=nofoldthrough_7,
    FlattenInputs=True)

# ----
plasticanchor = PlasticAnchor(Point=pt, Limit=1, Strength=pt, Reset=False)  # disabled

# ---- group: Flat Fold Restriction
edgelengths = EdgeLengths(Mesh=mesh, LengthFactor=1, Strength=1)
planarize = Planarize(M=srf4pt_4, Strength=1)  # disabled
entwine_4 = Entwine(Branch00=edgelengths, Branch01=planarize, FlattenInputs=True)

# ---- group: Display Controls
show = Show(G=mesh)

# ----
entwine_5 = Entwine(
    Branch00=grab.Grab,
    Branch01=show,
    Branch02=entwine_4,
    Branch03=entwine,
    Branch04=entwine_2,
    Branch05=entwine_3,
    Branch06=[anchor_2, anchor, plasticanchor, load, onplane],
    FlattenInputs=True)
solver = Solver(GoalObjects=entwine_5, Reset=reset, Threshold=1e-15, Tolerance=0.01, On=Toggle(True))  # -> I, V, O
preview = CustomPreview(Geometry=[solver.O, solver.V], Material=material)

# ==== cluster OriginalGeometry
panel = Panel("Point A")
panel_2 = Panel("Point B")
panel_3 = Panel("Point C")
number_slider = Slider(1, range=0..1)
number_slider_2 = Slider(0.598, range=0..1)
number_slider_3 = Slider(1, range=0..1)
vec = VectorXYZ(XComponent=Slider(0, range=0..1), YComponent=Slider(0, range=0..1), ZComponent=Slider(0, range=0..1))  # -> Vector, Length
vec_2 = VectorXYZ(XComponent=number_slider_2, YComponent=number_slider, ZComponent=Slider(0, range=0..1))  # -> Vector, Length
division = Division(A=number_slider, B=number_slider_2)
vec_3 = VectorXYZ(XComponent=number_slider_3, YComponent=Slider(0, range=0..1), ZComponent=Slider(0, range=0..1))  # -> Vector, Length
pt = Point(vec.Vector)
pt_2 = ClusterOutput(pt)
pt_3 = Point(vec_2.Vector)
atan = ArcTangent(Value=division)
pt_4 = Point(vec_3.Vector)
panel_4 = Panel("Point D")
addition = Addition(A=vec_2.Vector, B=vec_3.Vector)
pt_5 = Point(addition)
dom = ConstructDomain(DomainStart=atan, DomainEnd=Slider(0, range=0..100))
xy = XYPlane(Origin=Point(0, 0, 0))
Z = UnitZ(Factor=1)
srf4pt = _4PointSurface(CornerA=pt, CornerB=pt_3, CornerC=pt_5, CornerD=pt_4)
arc = Arc(Plane=xy, Radius=vec_2.Length, Angle=dom)  # -> Arc, Length
pl_3pt = Plane3Pt(PointA=pt, PointB=pt_4, PointC=Z)
# Slide this to collapse!
curvepoint = PointOnCurve(arc.Arc, parameter=0)
curvepoint_2 = ClusterOutput(curvepoint)
arc_2 = Arc(Plane=pl_3pt, Radius=number_slider_3, Angle=Domain(0, 3.141592654))  # -> Arc, Length
ln = Line(StartPoint=pt, EndPoint=pt_3)
ln_2 = Line(StartPoint=pt, EndPoint=curvepoint)
unit = UnitVector(Vector=pt_3)
angle = Angle(VectorA=ln, VectorB=ln_2)  # -> Angle, Reflex
dprod = DotProduct(VectorA=unit, VectorB=pt_4, Unitize=False)
neg = Negative(Value=angle.Angle)
multiplication = Multiplication(A=unit, B=dprod)
dist = Distance(PointA=pt_4, PointB=multiplication)
circle = CircleCNR(Center=multiplication, Normal=pt_3, Radius=dist)
rot3d = Rotate3D(Geometry=circle, Angle=neg, Center=Point(0, 0, 0), Axis=Vector(0, 0, 1))  # -> Geometry, Transform
ccx = CurveCurve(CurveA=rot3d.Geometry, CurveB=arc_2.Arc)  # -> Points, ParamsA, ParamsB
P = ClusterOutput(ccx.Points)
addition_2 = Addition(A=curvepoint, B=ccx.Points)
pdecon = Deconstruct(Point=ccx.Points)  # -> XComponent, YComponent, ZComponent
X = UnitX(Factor=1)
pt_6 = Point(addition_2)
pt_7 = ClusterOutput(pt_6)
multiplication_2 = Multiplication(A=pdecon.XComponent, B=X)
ln_3 = Line(StartPoint=curvepoint, EndPoint=pt_6)
ln_4 = Line(StartPoint=pt, EndPoint=ccx.Points)
ln_5 = Line(StartPoint=pt_6, EndPoint=ccx.Points)
pdecon_2 = Deconstruct(Point=curvepoint)  # -> XComponent, YComponent, ZComponent
pdecon_3 = Deconstruct(Point=pt_6)  # -> XComponent, YComponent, ZComponent
multiplication_3 = Multiplication(A=multiplication_2, B=Slider(2, range=0..10))
subtraction = Subtraction(A=pdecon_3.XComponent, B=pdecon_2.XComponent)
addition_3 = Addition(A=pt, B=multiplication_3)
R = ClusterOutput(addition_3)
multiplication_4 = Multiplication(A=subtraction, B=Slider(2, range=0..10))
X_2 = UnitX(Factor=1)
devec = DeconstructVector(Vector=addition_3)  # -> XComponent, YComponent, ZComponent
multiplication_5 = Multiplication(A=multiplication_4, B=X_2)
addition_4 = Addition(A=curvepoint, B=multiplication_5)
R_2 = ClusterOutput(addition_4)
srf4pt_2 = _4PointSurface(CornerA=pt, CornerB=curvepoint, CornerC=pt_6, CornerD=ccx.Points)
devec_2 = DeconstructVector(Vector=addition_4)  # -> XComponent, YComponent, ZComponent
pl_3pt_2 = Plane3Pt(PointA=addition_4, PointB=pt_6, PointC=curvepoint)
srf4pt_3 = _4PointSurface(CornerA=addition_4, CornerB=pt_6, CornerC=ccx.Points, CornerD=addition_3)
multiplication_6 = Multiplication(A=Slider(2, range=0..10), B=devec_2.YComponent)
mirror = Mirror(Geometry=[srf4pt_3, srf4pt_2], Plane=pl_3pt_2)  # -> Geometry, Transform
rectangle = Rectangle(Plane=PlaneXY(0, 0, 0), XSize=devec.XComponent, YSize=multiplication_6, Radius=0)  # -> Rectangle, Length
arrrec = RectangularArray(
    Geometry=[mirror.Geometry, srf4pt_3, srf4pt_2],
    Cell=rectangle.Rectangle,
    XCount=Slider(1, range=0..10),
    YCount=Slider(4, range=0..10))  # -> Geometry, Transform

# ==== cluster Extensions
G = ClusterInput()
G_2 = ClusterInput()
G_3 = ClusterInput()
A = ClusterInput()
xz = XZPlane(Origin=Point(0, 0, 0))
mirror = MirrorSurface(Geometry=G_2, Surface=xz, Frame=True)
mirror_2 = MirrorSurface(Geometry=G, Surface=xz, Frame=True)
G_4 = ClusterOutput(mirror_2)
mirror_3 = MirrorSurface(Geometry=G_3, Surface=xz, Frame=True)
pt = Point(mirror_3)
pt_2 = ClusterOutput(pt)
pt_3 = Point(mirror)
pt_4 = ClusterOutput(pt_3)
ln = Line(StartPoint=A, EndPoint=pt_3)
ln_2 = Line(StartPoint=pt_3, EndPoint=pt)
number_slider = Slider(1, range=0..10)
number_slider_2 = Slider(1, range=0..10)
recgrid = Rectangular(Plane=pt_3, SizeX=ln_2, SizeY=ln, ExtentX=1, ExtentY=1)  # -> flatten(Cells), Points
