# Grasshopper definition Miura Test 1.gh (Grasshopper 1.0.7)

panel = Panel("Point A")
panel_2 = Panel("Point B")
panel_3 = Panel("Point C")
number_slider = Slider(1, range=0..1)
number_slider_2 = Slider(0.598, range=0..1)
number_slider_3 = Slider(1, range=0..1)
vec = VectorXYZ(XComponent=Slider(0, range=0..1), YComponent=Slider(0, range=0..1), ZComponent=Slider(0, range=0..1))  # -> Vector, Length
vec_2 = VectorXYZ(XComponent=number_slider_2, YComponent=number_slider, ZComponent=Slider(0, range=0..1))  # -> Vector, Length
division = Division(A=number_slider, B=number_slider_2)
vec_3 = VectorXYZ(XComponent=number_slider_3, YComponent=Slider(0, range=0..1), ZComponent=Slider(0, range=0..1))  # -> Vector, Length
pt = Point(vec.Vector)
pt_2 = Point(vec_2.Vector)
atan = ArcTangent(Value=division)
pt_3 = Point(vec_3.Vector)
panel_4 = Panel("Point D")
addition = Addition(A=vec_2.Vector, B=vec_3.Vector)
pt_4 = Point(addition)
dom = ConstructDomain(DomainStart=atan, DomainEnd=Slider(0, range=0..100))
xy = XYPlane(Origin=Point(0, 0, 0))
Z = UnitZ(Factor=1)
srf4pt = _4PointSurface(CornerA=pt, CornerB=pt_2, CornerC=pt_4, CornerD=pt_3)
arc = Arc(Plane=xy, Radius=vec_2.Length, Angle=dom)  # -> Arc, Length
pl_3pt = Plane3Pt(PointA=pt, PointB=pt_3, PointC=Z)
# Slide this to collapse!
curvepoint = PointOnCurve(arc.Arc, parameter=0.193)
arc_2 = Arc(Plane=pl_3pt, Radius=number_slider_3, Angle=Domain(0, 3.141592654))  # -> Arc, Length
ln = Line(StartPoint=pt, EndPoint=pt_2)
ln_2 = Line(StartPoint=pt, EndPoint=curvepoint)
unit = UnitVector(Vector=pt_2)
angle = Angle(VectorA=ln, VectorB=ln_2)  # -> Angle, Reflex
dprod = DotProduct(VectorA=unit, VectorB=pt_3, Unitize=False)
neg = Negative(Value=angle.Angle)
multiplication = Multiplication(A=unit, B=dprod)
dist = Distance(PointA=pt_3, PointB=multiplication)
circle = CircleCNR(Center=multiplication, Normal=pt_2, Radius=dist)
rot3d = Rotate3D(Geometry=circle, Angle=neg, Center=Point(0, 0, 0), Axis=Vector(0, 0, 1))  # -> Geometry, Transform
ccx = CurveCurve(CurveA=rot3d.Geometry, CurveB=arc_2.Arc)  # -> Points, ParamsA, ParamsB
addition_2 = Addition(A=curvepoint, B=ccx.Points)
pdecon = Deconstruct(Point=ccx.Points)  # -> XComponent, YComponent, ZComponent
X = UnitX(Factor=1)
pt_5 = Point(addition_2)
multiplication_2 = Multiplication(A=pdecon.XComponent, B=X)
ln_3 = Line(StartPoint=curvepoint, EndPoint=pt_5)
ln_4 = Line(StartPoint=pt, EndPoint=ccx.Points)
ln_5 = Line(StartPoint=pt_5, EndPoint=ccx.Points)
pdecon_2 = Deconstruct(Point=curvepoint)  # -> XComponent, YComponent, ZComponent
pdecon_3 = Deconstruct(Point=pt_5)  # -> XComponent, YComponent, ZComponent
multiplication_3 = Multiplication(A=multiplication_2, B=Slider(2, range=0..10))
subtraction = Subtraction(A=pdecon_3.XComponent, B=pdecon_2.XComponent)
addition_3 = Addition(A=pt, B=multiplication_3)
multiplication_4 = Multiplication(A=subtraction, B=Slider(2, range=0..10))
X_2 = UnitX(Factor=1)
devec = DeconstructVector(Vector=addition_3)  # -> XComponent, YComponent, ZComponent
multiplication_5 = Multiplication(A=multiplication_4, B=X_2)
addition_4 = Addition(A=curvepoint, B=multiplication_5)
srf4pt_2 = _4PointSurface(CornerA=pt, CornerB=curvepoint, CornerC=pt_5, CornerD=ccx.Points)
devec_2 = DeconstructVector(Vector=addition_4)  # -> XComponent, YComponent, ZComponent
pl_3pt_2 = Plane3Pt(PointA=addition_4, PointB=pt_5, PointC=curvepoint)
srf4pt_3 = _4PointSurface(CornerA=addition_4, CornerB=pt_5, CornerC=ccx.Points, CornerD=addition_3)
multiplication_6 = Multiplication(A=Slider(2, range=0..10), B=devec_2.YComponent)
mirror = Mirror(Geometry=[srf4pt_3, srf4pt_2], Plane=pl_3pt_2)  # -> Geometry, Transform
rectangle = Rectangle(Plane=PlaneXY(0, 0, 0), XSize=devec.XComponent, YSize=multiplication_6, Radius=0)  # -> Rectangle, Length
arrrec = RectangularArray(
    Geometry=[mirror.Geometry, srf4pt_3, srf4pt_2],
    Cell=rectangle.Rectangle,
    XCount=Slider(10, range=0..10),
    YCount=Slider(10, range=0..10))  # -> Geometry, Transform
